# Grasshopper definition 02_TopologicPy_Speckle_rhV8.gh (Grasshopper 1.0.8)
# plug-ins: Speckle 2, TopologicGH, EleFront

about_version = AboutVersion()
# WORKFLOW 1:
# Revit > Speckle > Rhino + Topologic Py
toplogic_py_version = Panel(about_version)

list = ValueList({"Areas", "Areas::center", "Areas::level", "Areas::outline", "Areas::voids", "Casework", "Ceilings", "Columns", "Curtain Panels", "Curtain Wall Mullions"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}, selected="Structural Columns")
list_2 = ValueList({"Point": 0, "Curve": 1, "Arc": 2, "Circle": 3, "Ellipse": 4, "Line": 5, "Polyline": 6, "Surface": 7, "Brep": 8, "Mesh": 9, "Polysurface": 10, "Block": 11, "Text": 12, "TextDot": 13, "Dimension": 14, "LinearDimension": 15, "AngularDimension": 16, "Hatch": 17, "Leader": 18}, selected="Mesh")
list_3 = ValueList({"Point": 0, "Curve": 1, "Arc": 2, "Circle": 3, "Ellipse": 4, "Line": 5, "Polyline": 6, "Surface": 7, "Brep": 8, "Mesh": 9, "Polysurface": 10, "Block": 11, "Text": 12, "TextDot": 13, "Dimension": 14, "LinearDimension": 15, "AngularDimension": 16, "Hatch": 17, "Leader": 18}, selected="Block")
reflay_r6 = ReferenceByLayerR6(LayerName=list)
filtertype_r6 = FilterByTypeR6(Geometry=reflay_r6, ObjectType=list_2)
filtertype_r6_2 = FilterByTypeR6(Geometry=reflay_r6, ObjectType=list_3)
mesh = Mesh(simplify(flatten(filtertype_r6)))
deblock_r6 = DeconstructBlockR6(Block=filtertype_r6_2)  # -> simplify(Name), Plane, simplify(Geometry)
clean = CleanTree(RemoveNulls=True, RemoveInvalid=True, RemoveEmpty=True, Tree=deblock_r6.Geometry)  # -> simplify(flatten(Tree))
nullrep = ReplaceNulls(Items=mesh, Replacements=clean)  # -> Items, Count
mesh_2 = Mesh(mesh)

list_4 = ValueList({"Areas", "Areas::center", "Areas::level", "Areas::outline", "Areas::voids", "Casework", "Ceilings", "Columns", "Curtain Panels", "Curtain Wall Mullions"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}, selected="Columns")
list_5 = ValueList({"Point": 0, "Curve": 1, "Arc": 2, "Circle": 3, "Ellipse": 4, "Line": 5, "Polyline": 6, "Surface": 7, "Brep": 8, "Mesh": 9, "Polysurface": 10, "Block": 11, "Text": 12, "TextDot": 13, "Dimension": 14, "LinearDimension": 15, "AngularDimension": 16, "Hatch": 17, "Leader": 18}, selected="Mesh")
list_6 = ValueList({"Point": 0, "Curve": 1, "Arc": 2, "Circle": 3, "Ellipse": 4, "Line": 5, "Polyline": 6, "Surface": 7, "Brep": 8, "Mesh": 9, "Polysurface": 10, "Block": 11, "Text": 12, "TextDot": 13, "Dimension": 14, "LinearDimension": 15, "AngularDimension": 16, "Hatch": 17, "Leader": 18}, selected="Block")
reflay_r6_2 = ReferenceByLayerR6(LayerName=list_4)
filtertype_r6_3 = FilterByTypeR6(Geometry=reflay_r6_2, ObjectType=list_5)
filtertype_r6_4 = FilterByTypeR6(Geometry=reflay_r6_2, ObjectType=list_6)
mesh_3 = Mesh(simplify(flatten(filtertype_r6_3)))
deblock_r6_2 = DeconstructBlockR6(Block=filtertype_r6_4)  # -> simplify(Name), Plane, simplify(Geometry)
clean_2 = CleanTree(RemoveNulls=True, RemoveInvalid=True, RemoveEmpty=True, Tree=deblock_r6_2.Geometry)  # -> simplify(flatten(Tree))
nullrep_2 = ReplaceNulls(Items=mesh_3, Replacements=clean_2)  # -> Items, Count
mesh_4 = Mesh(nullrep_2.Items)

list_7 = ValueList({"Areas", "Areas::center", "Areas::level", "Areas::outline", "Areas::voids", "Casework", "Ceilings", "Columns", "Curtain Panels", "Curtain Wall Mullions"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}, selected="Rooms")
reflay_r6_3 = ReferenceByLayerR6(LayerName=list_7)
mesh_5 = Mesh(simplify(graft(reflay_r6_3)))
viewer = ParamViewer(mesh_5)

panel = Panel("""GROUND
COLUMNS 
CORE
BUILDING""")
bang = ExplodeTree(Data=simplify(graft(panel)))  # -> Branch0, Branch1, Branch2, Branch3
panel_2 = Panel(bang.Branch0)
panel_3 = Panel(bang.Branch1)
panel_4 = Panel(bang.Branch2)
panel_5 = Panel(bang.Branch3)

# ----
# WORKFLOW 2:
# Speckle > Grasshopper >  Topologic Py  > Rhino
list_8 = Accounts(
    {"No account selected": , "Account (arabhishek1091@gmail.com | https://app.speckle.systems)": "https://app.speckle.systems/?id=617efd7bc6"}, selected="Account (arabhishek1091@gmail.com | https://app.speckle.systems)",
    FirstSelectedItem="https://app.speckle.systems/?id=617efd7bc6")
slist = StreamList(Limit=10)

# ----
# GROUND
panel_6 = Panel("Outdoor Covered Dining")

# ----
# BUILDING
panel_7 = Panel("Two Story Studio Unit")

# ----
# CORE
panel_8 = Panel("Residential Lobby")

sdet = StreamDetails(Stream=slist)  # -> StreamID, Name, Description, CreatedAt, UpdatedAt, Public, Collaborators, Branches

streamlist = Panel(slist)
branches_of_the_stream = Panel(sdet.Branches)
name_of_the_stream = Panel(sdet.Name)
stream_id = Panel(sdet.StreamID)

merge = Merge(
    Data1="Bandstand",
    Data2="Live/Work Loft Unit",
    Data3="Green Roof",
    Data4="Café",
    Data5="Café Kitchen",
    Data6="Mezzanine Dining",
    Data7="Private Patio",
    Data8=panel_7,
    Data10="Office Unit",
    Data11="Studio Unit",
    Data12="Live/Work Unit",
    Data14="Utility",
    Data15="Storage",
    Data16="Machine RM")
merge_2 = Merge(Data1="Corridor", Data2="Elevator", Data3="Stair", Data4=panel_8)
merge_3 = Merge(Data1="Parking Garage", Data2=panel_6, Data3="Commercial/Retail", Data4="Pocket Park")
panel_9 = Panel(merge_2)

deatt_r6 = DeconstructAttributesR6(ReferencedGeometryOrAttributes=simplify(mesh_5))  # -> simplify(Keys), simplify(Values)
panel_10 = Panel(deatt_r6.Keys)

bbox = BoundingBox(Content=[mesh_4, mesh_2], Plane=PlaneXY(0, 0, 0), UnionBox=False)  # -> Box, Box_2

filteratt_r6 = FilterByUserAttributesR6(Attributes=mesh_5, Key="Name(ROOM_NAME)", Val=panel_9)  # -> Mesh, Key, Val
mesh_6 = Mesh(filteratt_r6.Mesh)

# ----
# BUILDING
panel_11 = Panel("Name(ROOM_NAME)")
filteratt_r6_2 = FilterByUserAttributesR6(Attributes=mesh_5, Key=panel_11, Val=merge)  # -> Mesh, Key, Val
mesh_7 = Mesh(filteratt_r6_2.Mesh)

# ----
# GROUND
panel_12 = Panel("Name(ROOM_NAME)")
filteratt_r6_3 = FilterByUserAttributesR6(Attributes=mesh_5, Key=panel_12, Val=merge_3)  # -> Mesh, Key, Val
mesh_8 = Mesh(filteratt_r6_3.Mesh)

# ----
# COLUMNS
# CORE
mesh_9 = Mesh(bbox.Box)

# ----
# Mesh to Brep
mesh_10 = Mesh(mesh_9)
faceb = FaceBoundaries(Mesh=mesh_10)
boundary = BoundarySurfaces(Edges=faceb)
join = BrepJoin(Breps=boundary)  # -> Breps, Closed
brep = Brep(join.Breps)

# ----
# Mesh to Brep
mesh_11 = Mesh(mesh_6)
faceb_2 = FaceBoundaries(Mesh=mesh_11)
boundary_2 = BoundarySurfaces(Edges=faceb_2)
join_2 = BrepJoin(Breps=boundary_2)  # -> Breps, Closed
brep_2 = Brep(join_2.Breps)

# ----
# Mesh to Brep
mesh_12 = Mesh(mesh_7)
faceb_3 = FaceBoundaries(Mesh=mesh_12)
boundary_3 = BoundarySurfaces(Edges=faceb_3)
join_3 = BrepJoin(Breps=boundary_3)  # -> Breps, Closed
brep_3 = Brep(join_3.Breps)

# ----
# Mesh to Brep
mesh_13 = Mesh(mesh_8)
faceb_4 = FaceBoundaries(Mesh=mesh_13)
boundary_4 = BoundarySurfaces(Edges=faceb_4)
join_4 = BrepJoin(Breps=boundary_4)  # -> Breps, Closed
brep_4 = Brep(join_4.Breps)
