# Grasshopper definition 03_TopologicPy_PrattTruss_rh8.gh (Grasshopper 1.0.8)
# plug-ins: RhinoCodePluginGH

pt = Point([<point referenced from the Rhino model> x30])
sort_pt = SortPoints(Points=pt)  # -> Points, Indices
pdecon = Deconstruct(Point=sort_pt.Points)  # -> XComponent, YComponent, ZComponent
concat = Concatenate(FragmentA=pdecon.XComponent, FragmentB=pdecon.YComponent, FragmentC=pdecon.ZComponent, JoinSeparator=",")
panel = Panel(concat)
py3 = Python3Script(ptcoordinates=panel)  # -> out, a, ptcoordinates_sorted, b; inputs ptcoordinates: list of String
# ---------- py3: Python ----------
"""Grasshopper Script"""
a = "Hello Python 3 in Grasshopper!"
print(a)


# Add brackers around each coordinates (strings) and print the result
ptcoordinates_sorted = ",".join([f"({coord})" for coord in ptcoordinates])
for sortedcoord in ptcoordinates_sorted:
    print(sortedcoord)
# ---------- end py3 ----------
panel_2 = Panel(py3.ptcoordinates_sorted)
